# Grasshopper definition line_model.ghx (Grasshopper 1.0.8)
# plug-ins: Human

range = Range(Domain=Domain(0, 1), Steps=Slider(4, range=0..10))
graph_mapper = GraphMapper(
    range,
    x0=0,
    x1=1,
    y0=0,
    y1=1,
    container_name="Bezier",
    cpx=[0, 0.8296880126, 0.8441684246, 1],
    cpy=[0.05491924286, 0.2432870269, 0.3775581717, 0.999725759])

# ----
# create and manipulate graph
curve = Curve(<curve referenced from the Rhino model>)
brep = Brep(<brep referenced from the Rhino model>)
point = Point([Point(163.5542514, 48.10027414, 15.94000248), Point(163.5542514, 57.72031214, 15.94000382), Point(173.1742514, 57.7202747, 19.94), Point(173.1742514, 48.1002747, 19.94)])
python_3_script = Python3Script(boundary=curve, roof_brep=brep, supports=point, z_steps=graph_mapper)  # -> out, ridges_tree, a, b, c, d, e, f, g; inputs boundary: Curve, roof_brep: Brep, supports: list of Point3d, z_steps: list of Double
# ---------- python_3_script: Python ----------
import os
import sys
from compas_rhino import unload_modules
import compas
compas.PRECISION = ".3f"

gh_dir = os.path.dirname(ghenv.Component.OnPingDocument().FilePath)
sys.path.append(gh_dir)

import tree_builder
import nodegraph
import importlib

importlib.reload(nodegraph)
importlib.reload(tree_builder)


from tree_builder import build_tree_graph


# CONSTANTS #
div_x = 8
div_y = 6
num_levels = 4
inset_edge = 0.6
inset_interior = 0.4

# Build the graph (all logic is in tree_builder.py)
ng = build_tree_graph(
    boundary=boundary,
    supports=supports,
    roof_brep=roof_brep,
    div_x=div_x if div_x else 8,
    div_y=div_y if div_y else 6,
    num_levels=num_levels if num_levels else 4,
    z_steps=z_steps,
    inset_edge=inset_edge if inset_edge else 0.5,
    inset_interior=inset_interior if inset_interior else 0.4,
    reach_tol=0.05,
    debug=True
)

# Outputs
a = ng.edge_lines_by_group(0)
b = ng.edge_lines_by_group(1)
c = ng
d = ng.node_points()
# ---------- end python_3_script ----------
compas_draw = COMPASDraw(cg=[python_3_script.a, python_3_script.b])  # -> rg
#   port cg: The COMPAS geometry or datastructure to be drawn.
#   port rg: The Rhino geometry object.
# ---------- compas_draw: Python ----------
# r: compas>=2.14.1
"""
Draws COMPAS geometry in Grasshopper.
"""

from typing import Any

import Grasshopper

from compas.scene import SceneObject


class CompasToRhinoGeometry(Grasshopper.Kernel.GH_ScriptInstance):
    def RunScript(self, cg):
        if not cg:
            return None

        return SceneObject(item=cg).draw()
# ---------- end compas_draw ----------
compas_draw_2 = COMPASDraw(cg=python_3_script.d)  # -> rg; same code as compas_draw
compas_draw_3 = COMPASDraw(cg=python_3_script.e)  # -> rg; same code as compas_draw
compas_draw_4 = COMPASDraw(cg=python_3_script.f)  # -> rg; same code as compas_draw
compas_draw_5 = COMPASDraw(cg=python_3_script.g)  # -> rg; same code as compas_draw
python_3_script_2 = Python3Script(graph=python_3_script.c)  # -> out, edges, nodes, idx, node_graph, a, b, c
# ---------- python_3_script_2: Python ----------
from copy import deepcopy
import os
import sys

gh_dir = os.path.dirname(ghenv.Component.OnPingDocument().FilePath)
if gh_dir not in sys.path:
    sys.path.insert(0, gh_dir)

ng = deepcopy(graph)

# Delete nodes
for node_id in [288, 289]:
    if ng.has_node(node_id):
        ng.delete_node(node_id)

target_pairs = [
    [286, 274, 275], [290, 278, 279], [287, 277, 276], [291, 280, 281],
    [241, 7, 11], [268, 234, 228], [265, 214, 208], [244, 31, 27],
    [287, 244], [287, 251], [287, 249],
    [291, 268], [291, 263], [291, 261],
    [290, 265], [290, 258], [290, 260],
    [286, 241], [286, 246], [286, 248]
]

ng.add_segments(target_pairs)

edges = ng.edge_lines_by_group(0) + ng.edge_lines_by_group(1)
nodes = ng.node_points()
idx = list(ng.nodes())
node_graph = ng

a = ng.points_by_mobility("fixed")     # supports + inset corners
b = ng.points_by_mobility("z_free")    # apex nodes
c = ng.points_by_mobility("xyz_free")  # added via add_segment
# ---------- end python_3_script_2 ----------

# ----
# Preview segments
number_slider = Slider(0, range=0..15)
python_3_script_3 = Python3Script(graph=python_3_script_2.node_graph, segment_id=number_slider)  # -> out, primary, secondary, subgraph; inputs segment_id: Int32
# ---------- python_3_script_3: Python ----------
import os, sys, importlib
gh_dir = os.path.dirname(ghenv.Component.OnPingDocument().FilePath)
if gh_dir not in sys.path:
    sys.path.insert(0, gh_dir)

import edge_classifier
importlib.reload(edge_classifier)
from edge_classifier import classify_graph_edges, classify_single_segment

result = classify_single_segment(graph, segment_index = segment_id,parallel_tol=0.9, near_threshold=1.0)

primary = result["primary_lines"]
secondary = result["secondary_lines"]
subgraph = result["subgraph"]
# ---------- end python_3_script_3 ----------
compas_draw_6 = COMPASDraw(cg=python_3_script_3.secondary)  # -> rg; same code as compas_draw
compas_draw_7 = COMPASDraw(cg=python_3_script_3.primary)  # -> rg; same code as compas_draw
custom_preview_lineweights = CustomPreviewLineweights(Geometry=compas_draw_6, Shader=ColourSwatch(SwatchColor=RGB(50, 143, 103)), Thickness="5", Absolute=False)
custom_preview_lineweights_2 = CustomPreviewLineweights(Geometry=compas_draw_7, Shader=ColourSwatch(SwatchColor=RGB(137, 50, 143)), Thickness="20", Absolute=False)

# ----
# Preview nodes
# fixed
# z-free
# xyz-free
compas_draw_8 = COMPASDraw(cg=python_3_script_2.nodes)  # -> rg; same code as compas_draw
compas_draw_9 = COMPASDraw(cg=python_3_script_2.edges)  # -> rg; same code as compas_draw
text_tag = TextTag(Location=compas_draw_8, Text=python_3_script_2.idx, Colour=ColourSwatch(SwatchColor=RGB(23, 64, 15)))
compas_draw_10 = COMPASDraw(cg=python_3_script_2.c)  # -> rg; same code as compas_draw
compas_draw_11 = COMPASDraw(cg=python_3_script_2.b)  # -> rg; same code as compas_draw
compas_draw_12 = COMPASDraw(cg=python_3_script_2.a)  # -> rg; same code as compas_draw
dot_display = DotDisplay(Point=compas_draw_10, Colour=ColourSwatch(SwatchColor=RGB(173, 201, 107)), Size=Slider(0.1, range=0..0.1))
dot_display_2 = DotDisplay(Point=compas_draw_11, Colour=ColourSwatch(SwatchColor=RGB(107, 201, 160)), Size=Slider(0.1, range=0..0.1))
dot_display_3 = DotDisplay(Point=compas_draw_12, Colour=ColourSwatch(SwatchColor=RGB(201, 107, 107)), Size=Slider(0.1, range=0..0.1))
